# Grasshopper definition Timber_Airport.gh (Grasshopper 1.0.8)
# plug-ins: RhinoCodePluginGH, LunchBox

number_slider = Slider(6, range=0..10)
number_slider_2 = Slider(8, range=0..20)
number_slider_3 = Slider(48, range=0..80)
number_slider_4 = Slider(88, range=0..200)
hight_base_plate = Slider(0.1, range=0..1)
rectangle = Rectangle(Plane=PlaneXY(0, 0, 0), XSize=number_slider_4, YSize=number_slider_3, Radius=0)  # -> Rectangle, Length
grid = GridStructure(Surface=rectangle.Rectangle, UDivisions=number_slider_2, VDivisions=number_slider)  # -> StructureLines, StructureNodes
Z = UnitZ(Factor=hight_base_plate)
boundary = BoundarySurfaces(Edges=rectangle.Rectangle)
extr = Extrude(Base=boundary, Direction=Z)
partition = PartitionList(List=grid.StructureNodes, Size=expr("x+1", number_slider))
path_mapper = PathMapper(partition, source="{A;B;C}", target="{C}")
series = Series(Start=number_slider, Step=-1, Count=expr("x+1", Slider(4, range=0..10)))  # -> flatten(Series)
# Grid
flip = FlipMatrix(Data=path_mapper)
branch = TreeBranch(Tree=flip, Path=series, MaintainPaths=True)

division = Division(A=number_slider_4, B=number_slider_2)
division_2 = Division(A=number_slider_3, B=number_slider)
panel = Panel(division)
panel_2 = Panel(division_2)
number_slider_5 = Slider(0.21, range=0..1)
number_slider_6 = Slider(0.8, range=0..1)
dom = ConstructDomain(DomainStart=number_slider_5, DomainEnd=expr("-x", number_slider_5))
dom_2 = ConstructDomain(DomainStart=number_slider_6, DomainEnd=expr("-x", number_slider_6))
rectangle_2 = Rectangle(Plane=PlaneXY(0, 0, 0), XSize=dom_2, YSize=dom, Radius=0)  # -> Rectangle, Length
number_slider_7 = Slider(2, range=2..5)
colour = ColourPicker(PickedColour=RGB(106, 196, 79))
layer = ModelLayer(Name="Demountable structure/ without floor", DisplayColour=colour)  # -> Layer, Name, Hidden, Locked, DisplayColour, Material, Linetype
colour_2 = ColourPicker(PickedColour=RGB(29, 145, 171))
layer_2 = ModelLayer(Name="Braces", DisplayColour=colour_2)  # -> Layer, Name, Hidden, Locked, DisplayColour, Material, Linetype
colour_3 = ColourPicker(PickedColour=RGB(135, 32, 32))
layer_3 = ModelLayer(Name="Permanent structure", DisplayColour=colour_3)  # -> Layer, Name, Hidden, Locked, DisplayColour, Material, Linetype

# ----
# Columns curves
pt = Point(branch)
radius_columns = Slider(0.2, range=0..1)
hight_columns = Slider(4, range=2..10)
move = Move(Geometry=pt, Motion=Z)  # -> Geometry, Transform
Z_2 = UnitZ(Factor=hight_columns)

pt_2 = Point(move.Geometry)
pt_3 = Point(move.Geometry)

move_2 = Move(Geometry=pt_2, Motion=Z_2)  # -> Geometry, Transform
ln = Line(StartPoint=pt_2, EndPoint=move_2.Geometry)

Z_3 = UnitZ(Factor=hight_columns)

# ----
# Beams x direction
hight_long = Slider(1, range=0..1)
width_long = Slider(0.185, range=0..1)
move_3 = Move(Geometry=pt_3, Motion=Z_3)  # -> Geometry, Transform
pline = PolyLine(Vertices=move_3.Geometry, Closed=False)
ext = ExtendCurve(Curve=pline, Type=0, Start=radius_columns, End=radius_columns)
end = EndPoints(Curve=ext)  # -> Start, End
len = Length(Curve=ext)
dom_3 = ConstructDomain(DomainStart=width_long, DomainEnd=expr("-x", width_long))
yz = YZPlane(Origin=end.Start)
X = UnitX(Factor=len)
rectangle_3 = Rectangle(Plane=yz, XSize=dom_3, YSize=hight_long, Radius=0)  # -> Rectangle, Length
extr_2 = Extrude(Base=rectangle_3.Rectangle, Direction=X)

# ----
# Beams y direction
width_short = Slider(0.2, range=0..1)
hight_short = Slider(0.6, range=0..1)
division_3 = Division(A=panel, B=Slider(3, range=0..10))
multiplication = Multiplication(A=division_3, B=2)
X_2 = UnitX(Factor=multiplication)
X_3 = UnitX(Factor=division_3)
dom_4 = ConstructDomain(DomainStart=width_short, DomainEnd=expr("-x", width_short))

subtraction = Subtraction(A=hight_long, B=hight_short)

addition = Addition(B=hight_long)
# Floor
max = Maximum(A=width_long, B=width_short)
pt_4 = Point(pt_3)
floor_width = Slider(0.26, range=0..1)
Z_4 = UnitZ(Factor=floor_width)

addition_2 = Addition(A=hight_columns, B=subtraction)
Z_5 = UnitZ(Factor=addition_2)
move_4 = Move(Geometry=pt_3, Motion=Z_5)  # -> Geometry, Transform
flip_2 = FlipMatrix(Data=move_4.Geometry)
pline_2 = PolyLine(Vertices=flip_2, Closed=False)
ext_2 = ExtendCurve(Curve=pline_2, Type=0, Start=radius_columns, End=radius_columns)

addition_3 = Addition(A=addition_2, B=hight_short)
p_n_c = PickNChoose(Pattern=Toggle(False), Stream0=addition_3, Stream1=addition)
Z_6 = UnitZ(Factor=p_n_c)
move_5 = Move(Geometry=pt_4, Motion=Z_6)  # -> Geometry, Transform
pt_5 = Point(flatten(move_5.Geometry))
viewer = ParamViewer(move_5.Geometry)
lng = ListLength(List=viewer)
srfgrid = SurfaceFromPoints(Points=pt_5, UCount=lng, Interpolate=False)
edges = BrepEdges(Brep=srfgrid)  # -> Naked, Interior, NonManifold
join = JoinCurves(Curves=edges.Naked, Preserve=False)
offset = OffsetCurve(Curve=join, Distance=max, Corners=1)
srf = Surface(offset)
addition_4 = Addition(A=p_n_c, B=floor_width)
extr_3 = Extrude(Base=srf, Direction=Z_4)

tstat = TreeStatistics(Tree=ext_2)  # -> Paths, Length, expr("x-1", Count)
path = DataPath(tstat.Count)
split = SplitTree(Data=ext_2, Masks=flatten(path))  # -> Positive, Negative

move_6 = Move(Geometry=split.Negative, Motion=X_3)  # -> Geometry, Transform
move_7 = Move(Geometry=split.Negative, Motion=X_2)  # -> Geometry, Transform

merge = Merge(Data1=ext_2, Data2=move_6.Geometry, Data3=move_7.Geometry)

end_2 = EndPoints(Curve=merge)  # -> Start, End
xz = XZPlane(Origin=end_2.Start)
len_2 = Length(Curve=merge)
rectangle_4 = Rectangle(Plane=xz, XSize=dom_4, YSize=hight_short, Radius=0)  # -> Rectangle, Length
Y = UnitY(Factor=len_2)
extr_4 = Extrude(Base=rectangle_4.Rectangle, Direction=Y)

join_2 = BrepJoin(Breps=[extr_4, extr_2])  # -> Breps, Closed

number_of_floors = Slider(3, range=0..4)
brep = Brep(extr_3)
brep_2 = Brep(join_2.Breps)
num = Number(addition_4)
crv = Curve(ln)
subtraction_2 = Subtraction(A=number_of_floors, B=1)
# Multiple floors
series_2 = Series(Start=0, Step=num, Count=number_of_floors)
series_3 = Series(Start=0, Step=num, Count=subtraction_2)
Z_7 = UnitZ(Factor=series_2)
Z_8 = UnitZ(Factor=series_3)
move_8 = Move(Geometry=graft(crv), Motion=Z_7)  # -> Geometry, Transform

move_9 = Move(Geometry=graft(brep_2), Motion=Z_8)  # -> Geometry, Transform
move_10 = Move(Geometry=graft(brep), Motion=Z_8)  # -> Geometry, Transform

# ---- group: Surface roof
py3 = Python3Script(columns=move_8.Geometry)  # -> out, a; inputs columns: list
# ---------- py3: Python ----------
import Rhino.Geometry as rg
from ghpythonlib import treehelpers
import Grasshopper

# Assuming 'columns' is a list of Breps representing the columns
if not isinstance(columns, list):
    columns = [columns]

# Initialize a dictionary to hold the base Z-coordinate (rounded) and associated columns
z_to_columns = {}

for column in columns:
    bbox = column.GetBoundingBox(True)
    base_z = round(bbox.Min.Z, 2)  # Adjust the rounding factor as needed
    if base_z not in z_to_columns:
        z_to_columns[base_z] = []
    z_to_columns[base_z].append(column)

# Sort the base Z-coordinates to maintain an ordered output
sorted_z_keys = sorted(z_to_columns.keys())

# Prepare data for tree output
sorted_columns_by_height = []
for z_key in sorted_z_keys:
    sorted_columns_by_height.append(z_to_columns[z_key])

# Convert list of lists to a data tree
a = treehelpers.list_to_tree(sorted_columns_by_height)
# ---------- end py3 ----------
path_mapper_2 = PathMapper(py3.a, source="{A;B}", target="{B}")
tstat_2 = TreeStatistics(Tree=py3.a)  # -> Paths, Length, expr("x-1", Count)
branch_2 = TreeBranch(Tree=path_mapper_2, Path=tstat_2.Count, MaintainPaths=True)
py3_2 = Python3Script(columns=branch_2)  # -> out, a; inputs columns: list
# ---------- py3_2: Python ----------
import Rhino.Geometry as rg
from ghpythonlib import treehelpers

# Ensure input is treated as a list
columns = columns if isinstance(columns, list) else [columns]

# Dictionary to hold Y-coordinates (rounded for grouping) and associated columns
y_groups = {}

for column in columns:
    # Get the centroid of the column base for a representative Y-coordinate
    bbox = column.GetBoundingBox(True)
    base_y = round(bbox.Min.Y, 1)  # Adjust rounding as necessary for grouping
    
    if base_y not in y_groups:
        y_groups[base_y] = [column]
    else:
        y_groups[base_y].append(column)

# Sorting and preparing for tree output
sorted_keys = sorted(y_groups.keys())
sorted_groups = [y_groups[key] for key in sorted_keys]

# Convert to data tree
a = treehelpers.list_to_tree(sorted_groups)
# ---------- end py3_2 ----------
pt_6 = Point(flip)
path_mapper_3 = PathMapper(py3_2.a, source="{A;B}", target="{B}")
tstat_3 = TreeStatistics(Tree=py3_2.a)  # -> Paths, Length, expr("x-1", Count)
branch_3 = TreeBranch(Tree=path_mapper_3, Path=tstat_3.Count, MaintainPaths=True)
branch_4 = TreeBranch(Tree=pt_6, Path="{0}", MaintainPaths=False)
end_3 = EndPoints(Curve=branch_3)  # -> Start, End
pt_7 = Point(branch_4)
Y_2 = UnitY(Factor=expr("-x", Slider(2, range=-5..5)))
pt_8 = Point(end_3.End)
pdecon = Deconstruct(Point=pt_8)  # -> XComponent, YComponent, ZComponent
move_11 = Move(Geometry=pt_7, Motion=Y_2)  # -> Geometry, Transform
addition_5 = Addition(A=Slider(-11, range=-20..10), B=pdecon.ZComponent)
Z_9 = UnitZ(Factor=addition_5)
move_12 = Move(Geometry=move_11.Geometry, Motion=Z_9)  # -> Geometry, Transform
# Surface top
merge_2 = Merge(Data1=move_12.Geometry, Data2=pt_7, Data3=pt_8)  # -> flatten(Result)
py3_3 = Python3Script(points=merge_2)  # -> out, a; inputs points: list
# ---------- py3_3: Python ----------
import Rhino.Geometry as rg
from ghpythonlib import treehelpers
import math

# Function to round points' X coordinates to a specific precision
def round_to_precision(x, precision=0.01):
    return round(x / precision) * precision

# Group points by their rounded X coordinate
groups = {}
for point in points:
    # Round the X coordinate to group points
    rounded_x = round_to_precision(point.X, 0.01)  # Adjust precision as needed
    if rounded_x not in groups:
        groups[rounded_x] = []
    groups[rounded_x].append(point)

# Convert the groups to a list of lists in sorted order by X coordinate
sorted_groups = [groups[key] for key in sorted(groups)]

# Convert the list of lists to a data tree
a = treehelpers.list_to_tree(sorted_groups)
# ---------- end py3_3 ----------
intcrv = Interpolate(Vertices=py3_3.a, Degree=3, Periodic=False, KnotStyle=1)  # -> Curve, Length, Domain
crv_2 = Curve(flatten(intcrv.Curve))
loft = Loft(Curves=crv_2, Options={Adjust=False, Closed=False, LoftEnds=0, LoftSimp=0, LoftType=0, Rebuild=10, Refit=0.01})
edges_2 = BrepEdges(Brep=loft)  # -> Naked, Interior, NonManifold
crv_3 = Curve(edges_2.Naked)
item = ListItem(List=crv_3, Index=1, Wrap=True)
item_2 = ListItem(List=crv_3, Index=-1, Wrap=True)
X_4 = UnitX(Factor=Slider(0.5, range=0..1))
move_13 = Move(Geometry=item, Motion=X_4)  # -> Geometry, Transform
flip_3 = FlipCurve(Curve=move_13.Geometry)  # -> Curve, Flag
loft_2 = Loft(
    Curves=[flip_3.Curve, item_2],
    Options={Adjust=False, Closed=False, LoftEnds=0, LoftSimp=0, LoftType=0, Rebuild=10, Refit=0.01})

# ----
crv_4 = Curve(intcrv.Curve)

# ---- group: Int: splitting top curve
# Slicing top curves
crv_5 = Curve(path_mapper_3)
tstat_4 = TreeStatistics(Tree=crv_5)  # -> Paths, Length, expr("x-1", Count)
path_2 = ConstructPath(Indices=tstat_4.Count)
split_2 = SplitTree(Data=crv_5, Masks=path_2)  # -> Positive, flatten(Negative)
flip_4 = FlipMatrix(Data=split_2.Negative)
Z_10 = UnitZ(Factor="100")
extr_5 = Extrude(Base=flip_4, Direction=Z_10)
end_4 = EndPoints(Curve=extr_5)  # -> Start, End
scx = SurfaceCurve(Surface=loft_2, Curve=extr_5)  # -> Curves, Points, UVPoints, Normals, Parameters, Tangents

# ----
divide = DivideCurve(Curve=crv_4, Count=10, Kinks=False)  # -> Points, Tangents, Parameters
pframe = PerpFrame(Curve=crv_4, Parameter=divide.Parameters)
orient = Orient(Geometry=rectangle_2.Rectangle, Source=PlaneXY(0, 0, 0), Target=pframe)  # -> Geometry, Transform
swp1 = Sweep1(Rail=crv_4, Sections=orient.Geometry, Miter=1)
crv_6 = Curve(crv_4)
pt_9 = Point(flatten(scx.Points))
py3_4 = Python3Script(y_points=pt_9)  # -> out, a; inputs y_points: list
# ---------- py3_4: Python ----------
import Rhino.Geometry as rg
from Grasshopper.Kernel.Data import GH_Path
from Grasshopper import DataTree

def sort_points_by_x(points, tolerance=0.01):
    # Initialize an empty dictionary for grouping points
    grouped_points = {}
    for pt in points:
        # Create a key for each group based on rounded X coordinate
        key = round(pt.Y / tolerance) * tolerance
        if key not in grouped_points:
            grouped_points[key] = []
        grouped_points[key].append(pt)
    
    # Sort the keys to ensure the output order is consistent
    sorted_keys = sorted(grouped_points.keys())
    
    # Initialize an empty DataTree for the sorted points
    sorted_tree = DataTree[rg.Point3d]()
    for i, key in enumerate(sorted_keys):
        path = GH_Path(i)
        for pt in grouped_points[key]:
            sorted_tree.Add(pt, path)
    
    return sorted_tree

# Assuming 'points' is your input list of points
# Sort the points into branches based on their X coordinate
sorted_points_tree = sort_points_by_x(y_points)

# Output the data tree
a = sorted_points_tree
# ---------- end py3_4 ----------
branch_5 = TreeBranch(Tree=py3_4.a, Path="{0}", MaintainPaths=True)

crv_7 = Curve(move_8.Geometry)
# Columns between floors
path_mapper_4 = PathMapper(crv_7, source="{A;B}", target="{path_index}")
flip_5 = FlipMatrix(Data=path_mapper_4)
tstat_5 = TreeStatistics(Tree=flip_5)  # -> Paths, Length, expr("x-1", Count)
series_4 = Series(Start=0, Step=1, Count=tstat_5.Count)
branch_6 = TreeBranch(Tree=flip_5, Path=series_4, MaintainPaths=True)

py3_5 = Python3Script(x_points=branch_5)  # -> out, a; inputs x_points: list
# ---------- py3_5: Python ----------
import Rhino.Geometry as rg
from Grasshopper.Kernel.Data import GH_Path
from Grasshopper import DataTree

def sort_points_by_x(points, tolerance=0.01):
    # Initialize an empty dictionary for grouping points
    grouped_points = {}
    for pt in points:
        # Create a key for each group based on rounded X coordinate
        key = round(pt.X / tolerance) * tolerance
        if key not in grouped_points:
            grouped_points[key] = []
        grouped_points[key].append(pt)
    
    # Sort the keys to ensure the output order is consistent
    sorted_keys = sorted(grouped_points.keys())
    
    # Initialize an empty DataTree for the sorted points
    sorted_tree = DataTree[rg.Point3d]()
    for i, key in enumerate(sorted_keys):
        path = GH_Path(i)
        for pt in grouped_points[key]:
            sorted_tree.Add(pt, path)
    
    return sorted_tree

# 'points' is input
# Sort the points into branches based on their X coordinate
sorted_points_tree = sort_points_by_x(x_points)

# Output the data tree
a = sorted_points_tree
# ---------- end py3_5 ----------
crv_cp = CurveClosestPoint(Point=py3_5.a, Curve=crv_6)  # -> Point, Parameter, Distance
shatter = Shatter(Curve=crv_6, Parameters=crv_cp.Parameter)
len_3 = Length(Curve=shatter)
flip_6 = FlipMatrix(Data=shatter)
path_mapper_5 = PathMapper(flip_6, source="{A;B;C}", target="{B}")
panel_3 = Panel(len_3)
branch_7 = TreeBranch(Tree=path_mapper_5, Path="1", MaintainPaths=True)  # -> graft(Branch)
branch_8 = TreeBranch(Tree=path_mapper_5, Path="0", MaintainPaths=True)
len_4 = Length(Curve=branch_8)
division_4 = Division(A=len_4, B=Slider(5, range=2..10))
divlength = DivideLength(Curve=branch_8, Length=division_4)  # -> Points, Tangents, Parameters
branch_9 = TreeBranch(Tree=divlength.Points, Path="{0;0}", MaintainPaths=True)

# ---- group: V braces
branch_10 = TreeBranch(Tree=path_mapper_5, Path="0", MaintainPaths=True)
divide_2 = DivideCurve(Curve=branch_10, Count=Slider(8, range=0..8), Kinks=False)  # -> flatten(Points), Tangents, Parameters
py3_6 = Python3Script(y_points=divide_2.Points)  # -> out, a; inputs y_points: list; same code as py3_4
branch_11 = TreeBranch(Tree=py3_6.a, Path="{1}", MaintainPaths=True)
branch_12 = TreeBranch(Tree=py3_6.a, Path="{0}", MaintainPaths=True)
pdecon_2 = Deconstruct(Point=branch_11)  # -> XComponent, YComponent, ZComponent
lng_2 = ListLength(List=pdecon_2.XComponent)
cull_i = CullIndex(List=pdecon_2.XComponent, Indices=lng_2, Wrap=True)
entwine = Entwine(Branch00=pdecon_2.XComponent, Branch01=cull_i, FlattenInputs=True)
flip_7 = FlipMatrix(Data=entwine)
clean = CleanTree(RemoveNulls=True, RemoveInvalid=True, RemoveEmpty=False, Tree=flip_7)
split_3 = SplitTree(Data=clean, Masks=flatten("{0;15}"))  # -> Positive, Negative
avr = Average(Input=split_3.Negative)
pt_10 = ConstructPoint(XCoordinate=avr, YCoordinate=0, ZCoordinate=0)
path_mapper_6 = PathMapper(pt_10, source="{A;B}", target="{path_index}")
pt_11 = Point(flatten(path_mapper_6))
lng_3 = ListLength(List=pt_11)
cull_i_2 = CullIndex(List=pt_11, Indices=expr("x-1", lng_3), Wrap=True)
pt_12 = Point(branch_12)
pt_13 = Point(cull_i_2)
lng_4 = ListLength(List=pt_12)
cull_i_3 = CullIndex(List=pt_12, Indices=expr("x-1", lng_4), Wrap=True)
cull_i_4 = CullIndex(List=pt_12, Indices="0", Wrap=True)
ln_2 = Line(StartPoint=pt_13, EndPoint=cull_i_4)
ln_3 = Line(StartPoint=pt_13, EndPoint=cull_i_3)

# ----
# Columns top floors
ln_4 = Line(StartPoint=scx.Points, EndPoint=end_4.Start)  # -> flatten(Line)
crv_8 = Curve(flatten(split_2.Positive))

flip_8 = FlipCurve(Curve=crv_8)  # -> Curve, Flag

entwine_2 = Entwine(Branch00=flip_8.Curve, Branch01=ln_4, FlattenInputs=True)  # -> graft(Result)
split_4 = SplitTree(Data=entwine_2, Masks=flatten("{0;2;0}"))  # -> Positive, Negative
path_mapper_7 = PathMapper(split_4.Negative, source="{A;B;C}", target="{path_index}")
crv_9 = Curve(flatten(path_mapper_7))
py3_7 = Python3Script(input_tree=crv_9)  # -> out, a; inputs input_tree: tree
# ---------- py3_7: Python ----------
import Rhino.Geometry as rg
import ghpythonlib.treehelpers as th
from collections import defaultdict
from Grasshopper import DataTree
from Grasshopper.Kernel.Data import GH_Path

def flatten_tree_to_list(tree):
    """Flatten a DataTree to a list."""
    flat_list = []
    for i in range(tree.BranchCount):
        branch = tree.Branch(i)
        for item in branch:
            flat_list.append(item)
    return flat_list

def get_y_key(y_value, tolerance=0.01):
    """Calculate a rounded key for Y coordinates considering a tolerance."""
    return round(y_value / tolerance)

def organize_by_y(lines, tolerance=0.01):
    """Organize lines by their Y coordinate."""
    y_groups = defaultdict(list)
    for line in lines:
        # Adjust to use .PointAtStart and .PointAtEnd for LineCurve objects
        mid_y = (line.PointAtStart.Y + line.PointAtEnd.Y) / 2
        y_key = get_y_key(mid_y, tolerance)
        y_groups[y_key].append(line)
    return y_groups

# Assuming 'input_tree' is already a flattened list of LineCurve objects
input_lines = flatten_tree_to_list(input_tree)  # Ensure input_tree is connected to the component

# Group lines by their Y coordinate
grouped_lines = organize_by_y(input_lines)

# Convert the grouped lines back into a DataTree
output_tree = DataTree[rg.GeometryBase]()
for group_key, lines in grouped_lines.items():
    path = GH_Path(group_key)
    for line in lines:
        output_tree.Add(line, path)

# Set the output
a = output_tree
# ---------- end py3_7 ----------
path_mapper_8 = PathMapper(py3_7.a, source="{A}", target="{path_index}")
tstat_6 = TreeStatistics(Tree=path_mapper_8)  # -> Paths, Length, Count
series_5 = Series(Start=0, Step=2, Count=expr("x/2", tstat_6.Count))
branch_13 = TreeBranch(Tree=path_mapper_8, Path=series_5, MaintainPaths=True)
flip_9 = FlipCurve(Curve=branch_13)  # -> Curve, Flag

# ----
# Split tree in lines to top and lines between floors
crv_10 = Curve(flatten(branch_6))
crv_11 = Curve(flatten(flip_9.Curve))
entwine_3 = Entwine(Branch00=crv_10, Branch01=crv_11, FlattenInputs=True)  # -> flatten(Result)
py3_8 = Python3Script(lines=entwine_3)  # -> out, a; inputs lines: list of Line
# ---------- py3_8: Python ----------
import Rhino.Geometry as rg
import ghpythonlib.treehelpers as th

def bottom_point(line):
    """Return the bottom point of a line based on Z coordinate."""
    return line.From if line.From.Z < line.To.Z else line.To

def similar_xy(point1, point2, tolerance=6):
    """Check if two points are similar in the XY plane within a given tolerance."""
    return point1.DistanceTo(point2) < tolerance

# Lines input is expected to be a list of Rhino.Geometry.Line
lines = lines

# Sort lines by the X then Y coordinates of their bottom points to group close ones
sorted_lines = sorted(lines, key=lambda line: (bottom_point(line).X, bottom_point(line).Y))

# Group lines with similar bottom points
grouped_lines = []
current_group = [sorted_lines[0]]

for line in sorted_lines[1:]:
    if similar_xy(bottom_point(line), bottom_point(current_group[-1])):
        current_group.append(line)
    else:
        grouped_lines.append(current_group)
        current_group = [line]

# Make sure to add the last group if it's not empty
if current_group:
    grouped_lines.append(current_group)

# Convert the grouped lines into a data tree
a = th.list_to_tree(grouped_lines)
# ---------- end py3_8 ----------
path_mapper_9 = PathMapper(py3_8.a, source="{A;B}", target="{B}")
branch_14 = TreeBranch(Tree=path_mapper_9, Path="{0}", MaintainPaths=True)
tstat_7 = TreeStatistics(Tree=path_mapper_9)  # -> Paths, Length, Count
lng_5 = ListLength(List=branch_14)
viewer_2 = ParamViewer(path_mapper_9)
equals = Equality(FirstNumber=lng_5, SecondNumber=tstat_7.Length)  # -> Equality, Inequality
panel_4 = Panel(path_mapper_9)
dispatch = Dispatch(List=viewer_2, DispatchPattern=equals.Equality)  # -> ListA, ListB
split_5 = SplitTree(Data=path_mapper_9, Masks=flatten(dispatch.ListA))  # -> Positive, Negative

end_5 = EndPoints(Curve=crv_11)  # -> Start, End
pt_14 = Point(end_5.End)
py3_9 = Python3Script(x_points=pt_14)  # -> out, a; inputs x_points: list; same code as py3_5
crv_cp_2 = CurveClosestPoint(Point=py3_9.a, Curve=branch_7)  # -> Point, Parameter, Distance
path_mapper_10 = PathMapper(crv_cp_2.Point, source="{A;B}", target="{path_index}")
shatter_2 = Shatter(Curve=branch_7, Parameters=crv_cp_2.Parameter)
midpt = CurveMiddle(Curve=shatter_2)
path_mapper_11 = PathMapper(midpt, source="{A;B;C}", target="{path_index}")
merge_3 = Merge(Data1=path_mapper_10, Data2=path_mapper_11)
pdecon_3 = Deconstruct(Point=merge_3)  # -> XComponent, YComponent, ZComponent
sort = SortList(Keys=pdecon_3.YComponent, ValuesA=pdecon_3.ZComponent)  # -> Keys, ValuesA
pt_15 = ConstructPoint(XCoordinate=pdecon_3.XComponent, YCoordinate=sort.Keys, ZCoordinate=sort.ValuesA)
branch_15 = TreeBranch(Tree=pt_15, Path="{0}", MaintainPaths=True)

number_slider_8 = Slider(0.3, range=0..1)
# Columns to top
number_slider_9 = Slider(0.3, range=0..1)
# Columns between floors
crv_12 = Curve(split_5.Negative)
crv_13 = Curve(crv_12)
dom_5 = ConstructDomain(DomainStart=number_slider_9, DomainEnd=expr("-x", number_slider_9))
dom_6 = ConstructDomain(DomainStart=number_slider_8, DomainEnd=expr("-x", number_slider_8))
end_6 = EndPoints(Curve=crv_13)  # -> Start, End
len_5 = Length(Curve=crv_13)
Z_11 = UnitZ(Factor=len_5)
rectangle_5 = Rectangle(Plane=end_6.Start, XSize=dom_6, YSize=dom_5, Radius=0)  # -> Rectangle, Length
extr_6 = Extrude(Base=rectangle_5.Rectangle, Direction=Z_11)

crv_14 = Curve(split_5.Positive)
number_slider_10 = Slider(0.3, range=0..1)
number_slider_11 = Slider(0.3, range=0..1)
crv_15 = Curve(crv_14)
dom_7 = ConstructDomain(DomainStart=number_slider_11, DomainEnd=expr("-x", number_slider_11))
dom_8 = ConstructDomain(DomainStart=number_slider_10, DomainEnd=expr("-x", number_slider_10))
end_7 = EndPoints(Curve=crv_15)  # -> Start, End
len_6 = Length(Curve=crv_15)
Z_12 = UnitZ(Factor=len_6)
rectangle_6 = Rectangle(Plane=end_7.Start, XSize=dom_8, YSize=dom_7, Radius=0)  # -> Rectangle, Length
extr_7 = Extrude(Base=rectangle_6.Rectangle, Direction=Z_12)
pt_16 = Point(end_7.Start)
pt_17 = Point(end_7.End)
merge_4 = Merge(Data1=pt_16, Data2=pt_17)
pline_3 = PolyLine(Vertices=merge_4, Closed=False)
end_8 = EndPoints(Curve=pline_3)  # -> Start, End
ln_5 = Line(StartPoint=end_8.Start, EndPoint=end_8.End)
len_7 = Length(Curve=ln_5)
rectangle_7 = Rectangle(Plane=end_8.Start, XSize=dom_8, YSize=dom_7, Radius=0)  # -> Rectangle, Length
Z_13 = UnitZ(Factor=len_7)
extr_8 = Extrude(Base=rectangle_7.Rectangle, Direction=Z_13)

# ---- group: X braces sides
crv_16 = Curve(crv_14)
end_9 = EndPoints(Curve=crv_16)  # -> Start, End
pt_18 = Point(flatten(end_9.End))
pt_19 = Point(flatten(end_9.Start))
py3_10 = Python3Script(x_points=pt_18)  # -> out, a; inputs x_points: list; same code as py3_5
py3_11 = Python3Script(x_points=pt_19)  # -> out, a; inputs x_points: list; same code as py3_5
tstat_8 = TreeStatistics(Tree=py3_10.a)  # -> Paths, Length, Count
tstat_9 = TreeStatistics(Tree=py3_11.a)  # -> Paths, Length, Count
series_6 = Series(Start=0, Step=1, Count=tstat_8.Count)
series_7 = Series(Start=0, Step=1, Count=tstat_9.Count)
py3_12 = Python3Script(points=series_6)  # -> out, a; inputs points: list
# ---------- py3_12: Python ----------
def create_pattern(length):
    # Initialize the pattern with all 'False'
    pattern = [False] * length

    # Always include the first and last elements
    pattern[0] = True
    pattern[-1] = True
    
    # Calculate the 1/4 and 3/4 positions
    one_half = int(length / 2)

    # Mark the 1/4 and 3/4 positions as True
    if length > 3:  # Check to ensure the list is long enough
        pattern[one_half] = True
    
    return pattern

# Get the length of the list of points
length = len(points)

# Create the pattern based on the list length
pattern = create_pattern(length)

# Output the pattern
a = pattern
# ---------- end py3_12 ----------
py3_13 = Python3Script(points=series_7)  # -> out, a; inputs points: list; same code as py3_12
cull = CullPattern(List=series_6, CullPattern=py3_12.a)
cull_2 = CullPattern(List=series_7, CullPattern=py3_13.a)
branch_16 = TreeBranch(Tree=py3_10.a, Path=cull, MaintainPaths=True)
branch_17 = TreeBranch(Tree=py3_11.a, Path=cull_2, MaintainPaths=True)
number_slider_12 = Slider(2, range=2..3)
py3_14 = Python3Script(y_points=branch_16)  # -> out, a; inputs y_points: list; same code as py3_4
py3_15 = Python3Script(y_points=branch_17)  # -> out, a; inputs y_points: list; same code as py3_4
tstat_10 = TreeStatistics(Tree=py3_15.a)  # -> Paths, Length, Count
tstat_11 = TreeStatistics(Tree=py3_14.a)  # -> Paths, Length, Count
series_8 = Series(Start=0, Step=1, Count=number_slider_12)
replace = ReplacePaths(Data=py3_15.a, Search=tstat_10.Paths, Replace=reverse(tstat_10.Paths))
replace_2 = ReplacePaths(Data=py3_14.a, Search=tstat_11.Paths, Replace=reverse(tstat_11.Paths))
series_9 = Series(Start=0, Step=1, Count=number_slider_12)
branch_18 = TreeBranch(Tree=replace_2, Path=series_8, MaintainPaths=True)
branch_19 = TreeBranch(Tree=replace, Path=series_9, MaintainPaths=True)
py3_16 = Python3Script(x_points=branch_19)  # -> out, a; inputs x_points: list; same code as py3_5
py3_17 = Python3Script(x_points=branch_18)  # -> out, a; inputs x_points: list; same code as py3_5
pt_20 = Point(py3_16.a)
pt_21 = Point(py3_17.a)
merge_5 = Merge(Data1=pt_20, Data2=pt_21)
shift = ShiftList(List=merge_5, Shift=Slider(3, range=1..20), Wrap=True)
ln_6 = Line(StartPoint=merge_5, EndPoint=shift)  # -> flatten(Line)
len_8 = Length(Curve=ln_6)
panel_5 = Panel(len_8)
expression = Expression(x=len_8, Expression="x>16")
cull_3 = CullPattern(List=ln_6, CullPattern=expression)

# ----
merge_6 = Merge(Data1=flatten(branch_9), Data2=flatten(branch_15))
pdecon_4 = Deconstruct(Point=merge_6)  # -> XComponent, YComponent, ZComponent

# ---- group: X braces end
crv_17 = Curve(flatten(crv_16))
py3_18 = Python3Script(columns=crv_17)  # -> out, a, b; inputs columns: list
# ---------- py3_18: Python ----------
import Rhino.Geometry as rg
from Grasshopper import DataTree
from Grasshopper.Kernel.Data import GH_Path

def sort_lines_by_coord(lines, coord):
    sorted_dict = {}
    for line in lines:
        # Check if the line is a LineCurve or a generic Curve and get the start point
        if isinstance(line, rg.LineCurve):
            start_point = line.PointAtStart
        elif isinstance(line, rg.Curve):  # For generic curve, use PointAtStart
            start_point = line.PointAtStart
        else:
            # If it's neither, try to directly use 'From' assuming it's a Line object
            # This else part may not be necessary if all inputs are guaranteed to be Curve objects
            start_point = line.From
        
        # Get the coordinate value based on the specified axis ('X' or 'Y')
        key = round(getattr(start_point, coord), 2)  # Round to handle floating-point imprecision
        
        # Group lines by rounded coordinate key
        if key not in sorted_dict:
            sorted_dict[key] = []
        sorted_dict[key].append(line)
    
    # Create a data tree from the sorted dictionary
    sorted_tree = DataTree[rg.GeometryBase]()
    for i, (key, lines) in enumerate(sorted(sorted_dict.items(), key=lambda x: x[0])):
        path = GH_Path(i)
        for line in lines:
            sorted_tree.Add(line, path)
    
    return sorted_tree

# Input: list of line-like or curve objects representing columns
sorted_tree_by_x = sort_lines_by_coord(columns, 'X')
sorted_tree_by_y = sort_lines_by_coord(columns, 'Y')

# Outputs
a = sorted_tree_by_x
b = sorted_tree_by_y
# ---------- end py3_18 ----------
tstat_12 = TreeStatistics(Tree=py3_18.b)  # -> Paths, Length, Count
replace_3 = ReplacePaths(Data=py3_18.b, Search=tstat_12.Paths, Replace=reverse(tstat_12.Paths))
branch_20 = TreeBranch(Tree=replace_3, Path="{0}", MaintainPaths=True)  # -> flatten(Branch)
py3_19 = Python3Script(columns=branch_20)  # -> out, a, b; inputs columns: list; same code as py3_18
tstat_13 = TreeStatistics(Tree=py3_19.a)  # -> Paths, Length, Count
series_10 = Series(Start=0, Step=1, Count=tstat_13.Count)
py3_20 = Python3Script(points=series_10)  # -> out, a, b; inputs points: list
# ---------- py3_20: Python ----------
def create_pattern(length, index):
    # Initialize the pattern with all 'False'
    pattern = [False] * length

    pattern[index] = True
    return pattern


# Get the length of the list of points
length = len(points)

# Create the pattern based on the list length
a = create_pattern(length, 1)
b = create_pattern(length, 2)
# ---------- end py3_20 ----------
py3_21 = Python3Script(points=series_10)  # -> out, a, b; inputs points: list
# ---------- py3_21: Python ----------
def create_pattern(length, index):
    # Initialize the pattern with all 'False'
    pattern = [False] * length

    pattern[index] = True
    return pattern


# Get the length of the list of points
length = len(points)

# Create the pattern based on the list length
a = create_pattern(length, -2)
b = create_pattern(length, -3)
# ---------- end py3_21 ----------
cull_4 = CullPattern(List=series_10, CullPattern=py3_20.a)
cull_5 = CullPattern(List=series_10, CullPattern=py3_21.a)
cull_6 = CullPattern(List=series_10, CullPattern=py3_20.b)
cull_7 = CullPattern(List=series_10, CullPattern=py3_21.b)
branch_21 = TreeBranch(Tree=py3_19.a, Path=cull_4, MaintainPaths=True)
branch_22 = TreeBranch(Tree=py3_19.a, Path=cull_6, MaintainPaths=True)
branch_23 = TreeBranch(Tree=py3_19.a, Path=cull_5, MaintainPaths=True)
branch_24 = TreeBranch(Tree=py3_19.a, Path=cull_7, MaintainPaths=True)
end_10 = EndPoints(Curve=branch_21)  # -> Start, End
end_11 = EndPoints(Curve=branch_23)  # -> Start, End
end_12 = EndPoints(Curve=branch_22)  # -> Start, End
end_13 = EndPoints(Curve=branch_24)  # -> Start, End
ln_7 = Line(StartPoint=end_10.Start, EndPoint=end_12.End)
ln_8 = Line(StartPoint=end_10.End, EndPoint=end_12.Start)
ln_9 = Line(StartPoint=end_11.Start, EndPoint=end_13.End)
ln_10 = Line(StartPoint=end_11.End, EndPoint=end_13.Start)
merge_7 = Merge(Data1=ln_7, Data2=ln_8, Data3=ln_9, Data4=ln_10)

# ---- group: X braces y direction
merge_8 = Merge(Data1=pt_15, Data2=divide_2.Points)  # -> flatten(Result)
py3_22 = Python3Script(y_points=merge_8)  # -> out, a; inputs y_points: list; same code as py3_4
py3_23 = Python3Script(x_points=merge_8)  # -> out, a; inputs x_points: list; same code as py3_5
pline_4 = PolyLine(Vertices=py3_22.a, Closed=False)
tstat_14 = TreeStatistics(Tree=py3_23.a)  # -> Paths, Length, Count
split_6 = SplitTree(Data=pline_4, Masks=flatten("{1}"))  # -> Positive, Negative
tstat_15 = TreeStatistics(Tree=py3_23.a)  # -> Paths, Length, Count
py3_24 = Python3Script(length=tstat_14.Count)  # -> out, a
# ---------- py3_24: Python ----------
def create_pattern(length):
    # Initialize the pattern with all 'False'
    pattern = [False] * length

    pattern[-2] = True
    pattern[-3] = True
    return pattern

# Get the length of the list of points

# Create the pattern based on the list length
pattern = create_pattern(length)

# Output the pattern
a = pattern
# ---------- end py3_24 ----------
series_11 = Series(Start=0, Step=1, Count=tstat_14.Count)
py3_25 = Python3Script(length=tstat_15.Count)  # -> out, a
# ---------- py3_25: Python ----------
def create_pattern(length):
    # Initialize the pattern with all 'False'
    pattern = [False] * length

    pattern[1] = True
    pattern[2] = True
    return pattern

# Get the length of the list of points

# Create the pattern based on the list length
pattern = create_pattern(length)

# Output the pattern
a = pattern
# ---------- end py3_25 ----------
series_12 = Series(Start=0, Step=1, Count=tstat_15.Count)
cull_8 = CullPattern(List=series_11, CullPattern=py3_24.a)
pipe = Pipe(Curve=split_6.Negative, Radius=Slider(0.2, range=0..1), Caps=0)
cull_9 = CullPattern(List=series_12, CullPattern=py3_25.a)
branch_25 = TreeBranch(Tree=py3_23.a, Path=cull_8, MaintainPaths=True)
path_mapper_12 = PathMapper(branch_25, source="{A}", target="{path_index}")
branch_26 = TreeBranch(Tree=py3_23.a, Path=cull_9, MaintainPaths=True)
path_mapper_13 = PathMapper(branch_26, source="{A}", target="{path_index}")
pt_22 = Point(path_mapper_12)
pt_23 = Point(path_mapper_12)
branch_27 = TreeBranch(Tree=pt_22, Path="1", MaintainPaths=True)
branch_28 = TreeBranch(Tree=pt_22, Path="0", MaintainPaths=True)
tstat_16 = TreeStatistics(Tree=branch_28)  # -> Paths, Length, Count
cull_i_5 = CullIndex(List=branch_27, Indices="0", Wrap=True)
cull_i_6 = CullIndex(List=branch_28, Indices=expr("x-1", tstat_16.Length), Wrap=True)
pt_24 = Point(path_mapper_13)
pt_25 = Point(path_mapper_13)
branch_29 = TreeBranch(Tree=pt_24, Path="1", MaintainPaths=True)
cullpt = CullDuplicates(Points=cull_i_6, Tolerance=0.1, CullMode=3)  # -> Points, Indices, Valence
cullpt_2 = CullDuplicates(Points=cull_i_5, Tolerance=0.1, CullMode=3)  # -> Points, Indices, Valence
branch_30 = TreeBranch(Tree=pt_24, Path="0", MaintainPaths=True)
branch_31 = TreeBranch(Tree=pt_23, Path="0", MaintainPaths=True)
branch_32 = TreeBranch(Tree=pt_23, Path="1", MaintainPaths=True)
tstat_17 = TreeStatistics(Tree=branch_30)  # -> Paths, Length, Count
tstat_18 = TreeStatistics(Tree=branch_32)  # -> Paths, Length, Count
ln_11 = Line(StartPoint=cullpt_2.Points, EndPoint=cullpt.Points)
cull_i_7 = CullIndex(List=branch_29, Indices="0", Wrap=True)
cull_i_8 = CullIndex(List=branch_30, Indices=expr("x-1", tstat_17.Length), Wrap=True)
cull_i_9 = CullIndex(List=branch_31, Indices="1", Wrap=True)
cull_i_10 = CullIndex(List=branch_32, Indices=expr("x-1", tstat_18.Length), Wrap=True)
cullpt_3 = CullDuplicates(Points=cull_i_8, Tolerance=0.1, CullMode=3)  # -> Points, Indices, Valence
cullpt_4 = CullDuplicates(Points=cull_i_7, Tolerance=0.1, CullMode=3)  # -> Points, Indices, Valence
branch_33 = TreeBranch(Tree=pt_25, Path="0", MaintainPaths=True)
cullpt_5 = CullDuplicates(Points=cull_i_10, Tolerance=0.1, CullMode=3)  # -> Points, Indices, Valence
cullpt_6 = CullDuplicates(Points=cull_i_9, Tolerance=0.1, CullMode=3)  # -> Points, Indices, Valence
branch_34 = TreeBranch(Tree=pt_25, Path="1", MaintainPaths=True)
cull_i_11 = CullIndex(List=ln_11, Indices="0", Wrap=True)
tstat_19 = TreeStatistics(Tree=branch_34)  # -> Paths, Length, Count
ln_12 = Line(StartPoint=cullpt_4.Points, EndPoint=cullpt_3.Points)
ln_13 = Line(StartPoint=cullpt_6.Points, EndPoint=cullpt_5.Points)
cull_i_12 = CullIndex(List=branch_33, Indices="1", Wrap=True)
cull_i_13 = CullIndex(List=branch_34, Indices=expr("x-1", tstat_19.Length), Wrap=True)
cull_i_14 = CullIndex(List=ln_12, Indices="0", Wrap=True)
cullpt_7 = CullDuplicates(Points=cull_i_13, Tolerance=0.1, CullMode=3)  # -> Points, Indices, Valence
cullpt_8 = CullDuplicates(Points=cull_i_12, Tolerance=0.1, CullMode=3)  # -> Points, Indices, Valence
ln_14 = Line(StartPoint=cullpt_8.Points, EndPoint=cullpt_7.Points)

# ---- group: X braces roof x-direction
py3_26 = Python3Script(y_points=merge_3)  # -> out, a; inputs y_points: list; same code as py3_4
number_slider_13 = Slider(2, range=0..10)
pt_26 = Point(py3_26.a)
tstat_20 = TreeStatistics(Tree=pt_26)  # -> Paths, Length, Count
series_13 = Series(Start=0, Step=1, Count=number_slider_13)
replace_4 = ReplacePaths(Data=pt_26, Search=tstat_20.Paths, Replace=reverse(tstat_20.Paths))
series_14 = Series(Start=1, Step=1, Count=number_slider_13)
branch_35 = TreeBranch(Tree=replace_4, Path=series_14, MaintainPaths=True)
branch_36 = TreeBranch(Tree=replace_4, Path=series_13, MaintainPaths=True)
tstat_21 = TreeStatistics(Tree=branch_35)  # -> Paths, Length, Count
tstat_22 = TreeStatistics(Tree=branch_36)  # -> Paths, Length, Count
cull_i_15 = CullIndex(List=branch_35, Indices="0", Wrap=True)
cull_i_16 = CullIndex(List=branch_35, Indices=expr("x-1", tstat_21.Length), Wrap=True)
cull_i_17 = CullIndex(List=branch_36, Indices="0", Wrap=True)
cull_i_18 = CullIndex(List=branch_36, Indices=expr("x-1", tstat_22.Length), Wrap=True)
ln_15 = Line(StartPoint=cull_i_16, EndPoint=cull_i_17)
ln_16 = Line(StartPoint=cull_i_18, EndPoint=cull_i_15)

# ----
merge_9 = Merge(Data1=extr_6, Data2=move_10.Geometry, Data3=move_9.Geometry)
object = ModelObject(Object=merge_9, Layer=layer.Layer)  # -> Object, Geometry, Name, Layer, Visibility, Display, Drafting, Render
merge_10 = Merge(Data3=ln_15, Data4=ln_16, Data5=cull_i_11, Data6=ln_13, Data7=cull_i_14, Data8=ln_14, Data9=ln_2, Data10=ln_3)  # -> flatten(Result)
merge_11 = Merge(Data1=cull_3, Data2=merge_10, Data3=merge_7)
crv_18 = Curve(flatten(merge_11))
len_9 = Length(Curve=crv_18)
ma = MassAddition(Input=len_9)  # -> Result, PartialResults
pipe_2 = Pipe(Curve=crv_18, Radius=Slider(0.05, range=0..1), Caps=0)
panel_6 = Panel(ma.Result)
object_2 = ModelObject(Object=pipe_2, Layer=layer_2.Layer)  # -> Object, Geometry, Name, Layer, Visibility, Display, Drafting, Render
merge_12 = Merge(Data1=extr_8, Data3=pipe, Data4=swp1)
object_3 = ModelObject(Object=merge_12, Layer=layer_3.Layer)  # -> Object, Geometry, Name, Layer, Visibility, Display, Drafting, Render
